# Dynamo graph Creating family types.dyn (Dynamo 2.6.1.8786)
# packages: Clockwork for Dynamo 1.x 1.34.0

file_path = Filename(".\Family sizes.xlsx")
file_from_path = FileObject(path=file_path)

# group: Window
string = StringInput("window")
importExcel = Data.ImportExcel(file=file_from_path, sheetName=string)
code_block = CodeBlock { 0; 1; 2; }
family_types = FamilyTypes("Windows_Sgl_Plain:1360x1210mm")
code_block_2 = CodeBlock { "Width"; "Height"; }

code_block_3 = CodeBlock { 1; }
dropItems = List.DropItems(list=importExcel, amount=code_block_3)

# group (continued): Window
transpose = List.Transpose(lists=dropItems)
getItemAtIndex = List.GetItemAtIndex(list=transpose, index=code_block.out0)
watch = Watch(getItemAtIndex)
getItemAtIndex_2 = List.GetItemAtIndex(list=transpose, index=code_block.out1)
watch_2 = Watch(getItemAtIndex_2)
getItemAtIndex_3 = List.GetItemAtIndex(list=transpose, index=code_block.out2)
watch_3 = Watch(getItemAtIndex_3)
duplicate = Custom[FamilyType.Duplicate](elementType=family_types, name=getItemAtIndex_3, lacing=Longest)  # package Clockwork for Dynamo 1.x; Duplicates a family type
setParameterByName = Element.SetParameterByName(element=duplicate, parameterName=code_block_2.out0, value=getItemAtIndex)
setParameterByName_2 = Element.SetParameterByName(element=duplicate, parameterName=code_block_2.out1, value=getItemAtIndex_2)

# group: Door
family_types_2 = FamilyTypes("Doors_IntSgl:1010x2110mm")
string_2 = StringInput("door")
importExcel_2 = Data.ImportExcel(file=file_from_path, sheetName=string_2)
code_block_4 = CodeBlock { 0; 1; 2; }
code_block_5 = CodeBlock { "Width"; "Height"; }

code_block_6 = CodeBlock { 1; }
dropItems_2 = List.DropItems(list=importExcel_2, amount=code_block_6)

# group (continued): Door
transpose_2 = List.Transpose(lists=dropItems_2)
getItemAtIndex_4 = List.GetItemAtIndex(list=transpose_2, index=code_block_4.out2)
duplicate_2 = Custom[FamilyType.Duplicate](elementType=family_types_2, name=getItemAtIndex_4, lacing=Longest)
getItemAtIndex_5 = List.GetItemAtIndex(list=transpose_2, index=code_block_4.out0)
setParameterByName_3 = Element.SetParameterByName(element=duplicate_2, parameterName=code_block_5.out0, value=getItemAtIndex_5)
getItemAtIndex_6 = List.GetItemAtIndex(list=transpose_2, index=code_block_4.out1)
setParameterByName_4 = Element.SetParameterByName(element=duplicate_2, parameterName=code_block_5.out1, value=getItemAtIndex_6)
watch_4 = Watch(getItemAtIndex_5)
watch_5 = Watch(getItemAtIndex_6)
watch_6 = Watch(getItemAtIndex_4)

# group: Column
family_types_3 = FamilyTypes("Columns_Rectangular:450x450mm")
string_3 = StringInput("column")
importExcel_3 = Data.ImportExcel(file=file_from_path, sheetName=string_3)
code_block_7 = CodeBlock { 0; 1; 2; }
code_block_8 = CodeBlock { "Width"; "Depth"; }

code_block_9 = CodeBlock { 1; }
dropItems_3 = List.DropItems(list=importExcel_3, amount=code_block_9)

# group (continued): Column
transpose_3 = List.Transpose(lists=dropItems_3)
getItemAtIndex_7 = List.GetItemAtIndex(list=transpose_3, index=code_block_7.out2)
duplicate_3 = Custom[FamilyType.Duplicate](elementType=family_types_3, name=getItemAtIndex_7, lacing=Longest)
getItemAtIndex_8 = List.GetItemAtIndex(list=transpose_3, index=code_block_7.out0)
setParameterByName_5 = Element.SetParameterByName(element=duplicate_3, parameterName=code_block_8.out0, value=getItemAtIndex_8)
watch_7 = Watch(getItemAtIndex_8)
getItemAtIndex_9 = List.GetItemAtIndex(list=transpose_3, index=code_block_7.out1)
setParameterByName_6 = Element.SetParameterByName(element=duplicate_3, parameterName=code_block_8.out1, value=getItemAtIndex_9)
watch_8 = Watch(getItemAtIndex_9)
watch_9 = Watch(getItemAtIndex_7)
