# Dynamo graph generating 3d objects.dyn (Dynamo 2.6.1.8786)
# packages: spring nodes 210.1.1

# group: Wall
file_path = Filename(".\Input Data.xlsx")
file_from_path = FileObject(path=file_path)
string = StringInput("wall")
importExcel = Data.ImportExcel(file=file_from_path, sheetName=string)
code_block = CodeBlock { 1; }
dropItems = List.DropItems(list=importExcel, amount=code_block)
transpose = List.Transpose(lists=dropItems)
code_block_2 = CodeBlock { 0; 1; 2; 3; 4; 5; 6; 7; 8; 9; 10; }
getItemAtIndex = List.GetItemAtIndex(list=transpose, index=code_block_2.out0)
getItemAtIndex_2 = List.GetItemAtIndex(list=transpose, index=code_block_2.out1)
byCoordinates = Point.ByCoordinates(x=getItemAtIndex, y=getItemAtIndex_2)
getItemAtIndex_3 = List.GetItemAtIndex(list=transpose, index=code_block_2.out2)
getItemAtIndex_4 = List.GetItemAtIndex(list=transpose, index=code_block_2.out3)
byCoordinates_2 = Point.ByCoordinates(x=getItemAtIndex_3, y=getItemAtIndex_4)
byStartPointEndPoint = Line.ByStartPointEndPoint(startPoint=byCoordinates, endPoint=byCoordinates_2)
getItemAtIndex_5 = List.GetItemAtIndex(list=transpose, index=code_block_2.out4)
getItemAtIndex_6 = List.GetItemAtIndex(list=transpose, index=code_block_2.out7)
getItemAtIndex_7 = List.GetItemAtIndex(list=transpose, index=code_block_2.out5)
byElevationAndName = Level.ByElevationAndName(elevation=getItemAtIndex_6, name=getItemAtIndex_7)
getItemAtIndex_8 = List.GetItemAtIndex(list=transpose, index=code_block_2.out6)
string_from_object = FromObject(object=getItemAtIndex_8)
byName = WallType.ByName(name=string_from_object)
byCurveAndHeight = Wall.ByCurveAndHeight(curve=byStartPointEndPoint, height=getItemAtIndex_5, level=byElevationAndName, wallType=byName)

# group: Doors
string_2 = StringInput("door")
importExcel_2 = Data.ImportExcel(file=file_from_path, sheetName=string_2)
code_block_3 = CodeBlock { 1; }
dropItems_2 = List.DropItems(list=importExcel_2, amount=code_block_3)
transpose_2 = List.Transpose(lists=dropItems_2)
code_block_4 = CodeBlock { 0; 1; 2; 3; 4; 5; 6; 7; 8; 9; 10; }
getItemAtIndex_9 = List.GetItemAtIndex(list=transpose_2, index=code_block_4.out3)
getItemAtIndex_10 = List.GetItemAtIndex(list=transpose_2, index=code_block_4.out4)
string_from_object_2 = FromObject(object=getItemAtIndex_10)
byName_2 = FamilyType.ByName(name=string_from_object_2)
getItemAtIndex_11 = List.GetItemAtIndex(list=transpose_2, index=code_block_4.out0)
getItemAtIndex_12 = List.GetItemAtIndex(list=transpose_2, index=code_block_4.out1)
getItemAtIndex_13 = List.GetItemAtIndex(list=transpose_2, index=code_block_4.out2)
byCoordinates_3 = Point.ByCoordinates(x=getItemAtIndex_11, y=getItemAtIndex_12, z=getItemAtIndex_13)
ꟿ_familyinstance_byhostandpoint = Custom[ꟿ FamilyInstance.ByHostAndPoint](host=byCurveAndHeight, type=byName_2, point=byCoordinates_3)  # package spring nodes; Creates hosted family instances(doors/windows) at the specified points. You can feed either a single family type or a unique type for each instance.

# group: Windows
string_3 = StringInput("window")
importExcel_3 = Data.ImportExcel(file=file_from_path, sheetName=string_3)
code_block_5 = CodeBlock { 1; }
dropItems_3 = List.DropItems(list=importExcel_3, amount=code_block_5)
transpose_3 = List.Transpose(lists=dropItems_3)
code_block_6 = CodeBlock { 0; 1; 2; 3; 4; 5; 6; 7; 8; 9; 10; }
getItemAtIndex_14 = List.GetItemAtIndex(list=transpose_3, index=code_block_6.out3)
getItemAtIndex_15 = List.GetItemAtIndex(list=transpose_3, index=code_block_6.out4)
string_from_object_3 = FromObject(object=getItemAtIndex_15)
byName_3 = FamilyType.ByName(name=string_from_object_3)
getItemAtIndex_16 = List.GetItemAtIndex(list=transpose_3, index=code_block_6.out0)
getItemAtIndex_17 = List.GetItemAtIndex(list=transpose_3, index=code_block_6.out1)
getItemAtIndex_18 = List.GetItemAtIndex(list=transpose_3, index=code_block_6.out2)
byCoordinates_4 = Point.ByCoordinates(x=getItemAtIndex_16, y=getItemAtIndex_17, z=getItemAtIndex_18)
ꟿ_familyinstance_byhostandpoint_2 = Custom[ꟿ FamilyInstance.ByHostAndPoint](host=byCurveAndHeight, type=byName_3, point=byCoordinates_4)

code_block_7 = CodeBlock {  }
